# Grasshopper definition rhino-grasshopper.gh (Grasshopper 1.0.7)
# plug-ins: HAL for Grasshopper

# ----
# Posicionamiento
panel = Panel("220")
rectangle = Rectangle(Plane=PlaneXY(0, 0, 0), XSize=panel, YSize=panel, Radius=0)  # -> Rectangle, Length
area = Area(Geometry=rectangle.Rectangle)  # -> Area, Centroid

# ----
# Exploración de voladizos
number_slider = Slider(0, range=0..50)
cir = Circle(Plane=area.Centroid, Radius=Slider(30, range=0..100))
cir_2 = Circle(Plane=area.Centroid, Radius=Slider(30, range=0..100))
vec = VectorXYZ(XComponent=number_slider, YComponent=number_slider, ZComponent=Slider(50, range=0..100))  # -> Vector, Length
move = Move(Geometry=cir_2, Motion=vec.Vector)  # -> Geometry, Transform
loft = Loft(
    Curves=[cir, move.Geometry],
    Options={Adjust=False, Closed=False, LoftEnds=0, LoftSimp=0, LoftType=0, Rebuild=10, Refit=0.01})

# ----
# Toolpath con “pelos”
number_slider_2 = Slider(0, range=0..50)
cir_3 = Circle(Plane=area.Centroid, Radius=Slider(30, range=0..100))
cir_4 = Circle(Plane=area.Centroid, Radius=Slider(30, range=0..100))
vec_2 = VectorXYZ(XComponent=number_slider_2, YComponent=number_slider_2, ZComponent=Slider(50, range=0..100))  # -> Vector, Length
move_2 = Move(Geometry=cir_4, Motion=vec_2.Vector)  # -> Geometry, Transform
loft_2 = Loft(
    Curves=[cir_3, move_2.Geometry],
    Options={Adjust=False, Closed=False, LoftEnds=0, LoftSimp=0, LoftType=0, Rebuild=10, Refit=0.01})

# ----
# Planar
altura_de_capa = Panel("2")
contour = Contour(Shape=loft_2, Point=Point(0, 0, 0), Direction=Vector(0, 0, 1), Distance=altura_de_capa)

# ----
# Planar
altura_de_capa_2 = Panel("2")
contour_2 = Contour(Shape=loft, Point=Point(0, 0, 0), Direction=Vector(0, 0, 1), Distance=altura_de_capa_2)

# ----
# Generacion de "pelos"
panel_2 = Panel("""False
False
True""")
dispatch = Dispatch(List=flatten(contour), DispatchPattern=panel_2)  # -> ListA, ListB
offset = OffsetCurve(Curve=dispatch.ListA, Distance=Slider(5, range=0..10), Corners=1)
number_slider_3 = Slider(50, range=0..100)
divide = DivideCurve(Curve=dispatch.ListA, Count=number_slider_3, Kinks=False)  # -> Points, Tangents, Parameters
divide_2 = DivideCurve(Curve=offset, Count=number_slider_3, Kinks=False)  # -> Points, Tangents, Parameters
dispatch_2 = Dispatch(List=divide.Points, DispatchPattern=[True, False])  # -> ListA, ListB
dispatch_3 = Dispatch(List=divide_2.Points, DispatchPattern=[True, False])  # -> ListA, ListB
weave = Weave(Pattern=[0, 1], Stream0=dispatch_2.ListA, Stream1=dispatch_3.ListB, NullGaps=False)
pline = PolyLine(Vertices=weave, Closed=Toggle(True))  # -> flatten(Polyline)
panel_3 = Panel("""True
False
False""")
weave_2 = Weave(Pattern=panel_3, Stream0=dispatch.ListB, Stream1=pline, NullGaps=False)
area_2 = Area(Geometry=weave_2)  # -> Area, Centroid
devec = DeconstructVector(Vector=area_2.Centroid)  # -> XComponent, YComponent, ZComponent
sort = SortList(Keys=devec.ZComponent, ValuesA=weave_2)  # -> Keys, ValuesA
divide_3 = DivideCurve(Curve=sort.ValuesA, Count=Slider(50, range=0..100), Kinks=False)  # -> flatten(Points), Tangents, Parameters
pline_2 = PolyLine(Vertices=divide_3.Points, Closed=False)

# ----
# Altura de "capa"
number_slider_4 = Slider(28, range=0..50)
range = Range(Domain=Domain(0, 1), Steps=number_slider_4)

# ----
# Impresión no planar
number_slider_5 = Slider(0, range=0..50)
cir_5 = Circle(Plane=area.Centroid, Radius=Slider(30, range=0..100))
cir_6 = Circle(Plane=area.Centroid, Radius=Slider(30, range=0..100))
vec_3 = VectorXYZ(XComponent=number_slider_5, YComponent=number_slider_5, ZComponent=Slider(50, range=0..100))  # -> Vector, Length
move_3 = Move(Geometry=cir_6, Motion=vec_3.Vector)  # -> Geometry, Transform
divide_4 = DivideCurve(Curve=move_3.Geometry, Count=10, Kinks=False)  # -> Points, Tangents, Parameters
dispatch_4 = Dispatch(List=divide_4.Points, DispatchPattern=[True, False])  # -> ListA, ListB
Z = UnitZ(Factor=Slider(5, range=0..10))
move_4 = Move(Geometry=dispatch_4.ListB, Motion=Z)  # -> Geometry, Transform
weave_3 = Weave(Pattern=[0, 1], Stream0=dispatch_4.ListA, Stream1=move_4.Geometry, NullGaps=False)
intcrv = Interpolate(Vertices=weave_3, Degree=3, Periodic=Toggle(True), KnotStyle=1)  # -> Curve, Length, Domain
tweencrv = TweenCurve(CurveA=cir_5, CurveB=intcrv.Curve, Factor=range, BlendType=0)

# ----
# Análisis alturas de capa
item = ListItem(List=tweencrv, Index=0, Wrap=True)  # -> Item, Item1
item_2 = ListItem(List=tweencrv, Index=0, Wrap=True)  # -> Item2, Item1, Item
divide_5 = DivideCurve(Curve=item_2.Item1, Count="100", Kinks=False)  # -> Points, Tangents, Parameters
divide_6 = DivideCurve(Curve=item_2.Item2, Count="100", Kinks=False)  # -> Points, Tangents, Parameters
divide_7 = DivideCurve(Curve=item.Item, Count="100", Kinks=False)  # -> Points, Tangents, Parameters
divide_8 = DivideCurve(Curve=item.Item1, Count="100", Kinks=False)  # -> Points, Tangents, Parameters
ln = Line(StartPoint=divide_7.Points, EndPoint=divide_8.Points)
ln_2 = Line(StartPoint=divide_6.Points, EndPoint=divide_5.Points)
len = Length(Curve=ln)
len_2 = Length(Curve=ln_2)
bnd = Bounds(Numbers=len)
bnd_2 = Bounds(Numbers=len_2)
panel_4 = Panel(bnd_2)
panel_5 = Panel(bnd)

# ----
# Generación toolpath
flip = FlipCurve(Curve=contour_2, Guide=cir)  # -> Curve, Flag
divide_9 = DivideCurve(Curve=flip.Curve, Count=Slider(39, range=0..50), Kinks=False)  # -> flatten(Points), Tangents, Parameters
pline_3 = PolyLine(Vertices=divide_9.Points, Closed=False)

# ----
# Generación toolpath
number_slider_6 = Slider(100, range=0..100)
divide_10 = DivideCurve(Curve=tweencrv, Count=number_slider_6, Kinks=False)  # -> flatten(Points), Tangents, Parameters
pline_4 = PolyLine(Vertices=divide_10.Points, Closed=False)

session_settings = SessionSettings()

# ----
# Cilindro continuo
number_slider_7 = Slider(50, range=0..100)
# Ejercicio: Exploración de estrategias de impresión
# En este ejercicio encontrarán cuatro opciones de slicer, todas diseñadas para generar toolpaths continuos.
# Las opciones están ordenadas desde la más simple hasta la más compleja, permitiendo explorar distintas condiciones de impresión.
# 
# 1. Cilindro continuo (nivel básico)
# 
# La opción más simple consiste en imprimir un cilindro con un toolpath continuo.
# La dificultad principal aquí no está en la geometría, sino en definir correctamente los parámetros de impresión, especialmente:
# •Flujo de material
# •Velocidad de impresión
# La idea es que ustedes encuentren una combinación estable entre ambos parámetros.
# 
# 2. Exploración de voladizos
# 
# En esta opción el toolpath comienza a generar pequeños voladizos, permitiendo evaluar hasta qué punto el material puede sostenerse sin soporte.
# Aquí se busca observar cómo influyen el flujo, la velocidad y la altura de capa en la estabilidad de la impresión.
# 
# 3. Toolpath con “pelos”
# 
# En esta estrategia el recorrido genera zonas donde el toolpath se separa ligeramente del cuerpo principal, creando pequeñas extensiones o “pelos”.
# El objetivo es analizar qué tan lejos puede “volar” el material antes de perder estabilidad.
# 
# 4. Impresión no planar
# 
# La última opción introduce movimientos no planares, donde el toolpath deja de trabajar únicamente por capas horizontales.
# Esto permite explorar nuevas posibilidades formales y comprender las limitaciones del sistema de impresión.
# 
# Este ejercicio es solo un ejemplo inicial.
# Se recomienda jugar con el código, probar distintos parámetros y experimentar con las variables para entender mejor el comportamiento del material y de la máquina.
# 
# La exploración y prueba son parte fundamental del proceso.
number_slider_8 = Slider(30, range=0..100)
cir_7 = Circle(Plane=area.Centroid, Radius=number_slider_8)
cir_8 = Circle(Plane=area.Centroid, Radius=Slider(30, range=0..100))

Z_2 = UnitZ(Factor=number_slider_7)

move_5 = Move(Geometry=cir_8, Motion=Z_2)  # -> Geometry, Transform
loft_3 = Loft(
    Curves=[cir_7, move_5.Geometry],
    Options={Adjust=False, Closed=False, LoftEnds=0, LoftSimp=0, LoftType=0, Rebuild=10, Refit=0.01})

# ----
# Planar
altura_de_capa_3 = Panel("2")
contour_3 = Contour(Shape=loft_3, Point=Point(0, 0, 0), Direction=Vector(0, 0, 1), Distance=altura_de_capa_3)

# ----
# Generación toolpath
flip_2 = FlipCurve(Curve=contour_3, Guide=cir_7)  # -> Curve, Flag
divide_11 = DivideCurve(Curve=flip_2.Curve, Count=Slider(39, range=0..50), Kinks=False)  # -> flatten(Points), Tangents, Parameters
pline_5 = PolyLine(Vertices=divide_11.Points, Closed=False)

merge = Merge(Data1=pline_5, Data2=pline_3, Data3=pline_2, Data4=pline_4)
item_3 = ListItem(List=merge, Index=Slider(2, range=0..2), Wrap=True)

cp = ControlPoints(Curve=item_3)  # -> Points, Weights, Knots
explode = Explode(Curve=item_3, Recursive=True)  # -> Segments, Vertices
len_3 = Length(Curve=explode.Segments)
pdecon = Deconstruct(Point=flatten(cp.Points))  # -> XComponent, YComponent, ZComponent
ins = InsertItems(List=len_3, Item="0", Indices="0", Wrap=True)
redondeo = Redondeo(A=pdecon.XComponent)
redondeo_2 = Redondeo(A=pdecon.YComponent)
redondeo_3 = Redondeo(A=pdecon.ZComponent)
redondeo_4 = Redondeo(A=ins)
ma = MassAddition(Input=flatten(redondeo_4))  # -> Result, PartialResults
panel_6 = Panel("""; Ender 3 Custom Start G-code
M104 S{material_print_temperature_layer_0} ; Set Extruder temperature
M140 S{material_bed_temperature_layer_0} ; Set Heat Bed temperature
M190 S{material_bed_temperature_layer_0} ; Wait for Heat Bed temperature
M109 S{material_print_temperature_layer_0} ; Wait for Extruder temperature
G28 ; Home all axes
M117 Purge extruder
G92 E0 ; Reset Extruder
G1 Z2.0 F3000 ; Move Z Axis up little to prevent scratching of Heat Bed
G1 X0.1 Y20 Z0.3 F5000.0 ; Move to start position
G1 X0.1 Y200.0 Z0.3 F1500.0 E15 ; Draw the first line
G1 X0.4 Y200.0 Z0.3 F5000.0 ; Move to side a little
G1 X0.4 Y20 Z0.3 F1500.0 E30 ; Draw the second line
G92 E0 ; Reset Extruder
G1 Z2.0 F3000 ; Move Z Axis up little to prevent scratching of Heat Bed
M117 By your command!
; End of custom start GCode""")
panel_7 = Panel("""; Ender 3 Custom End G-code
G4 ; Wait
M220 S100 ; Reset Speed factor override percentage to default (100%)
M221 S100 ; Reset Extrude factor override percentage to default (100%)
G91 ; Set coordinates to relative
G1 F1800 E-3 ; Retract filament 3 mm to prevent oozing
G1 F3000 Z20 ; Move Z Axis up 20 mm to allow filament ooze freely
G90 ; Set coordinates to absolute
G1 X0 Y{machine_depth} F1000 ; Move Heat Bed to the front for easy print removal
M106 S0 ; Turn off cooling fan
M104 S0 ; Turn off extruder
M140 S0 ; Turn off bed
M107 ; Turn off Fan
M84 ; Disable stepper motors
M117 That's All Folks!
; End of custom end GCode""")
concat = Concatenate(
    FragmentA="G1",
    FragmentD="X",
    FragmentE=redondeo,
    FragmentF="Y",
    FragmentG=redondeo_2,
    FragmentH="Z",
    FragmentI=redondeo_3,
    FragmentJ="E",
    FragmentK=ma.PartialResults)
merge_2 = Merge(Data1=panel_7, Data2=concat, Data3=panel_6)
panel_8 = Panel(merge_2)

# ==== cluster Redondeo
number_slider = Slider(10, range=0..10)
A = ClusterInput()
multiplication = Multiplication(A=A, B=number_slider)
int = Integer(multiplication)
division = Division(A=int, B=number_slider)
R = ClusterOutput(division)
